# Grasshopper definition test-cantilever.gh (Grasshopper 0.9.14)
# plug-ins: SharpFEGrasshopper.Core

pt = Point(Point(0, 3000, 0))
pt_2 = Point(Point(0, 0, 0))
M = ElasticMaterial(YoungsModulus=210000, Density=100, PoissonsRatio=0.3, ShearModulus=1000)
ln = Line(StartPoint=pt_2, EndPoint=pt)
cs = RectangularCrossSection(Heigth=100, Width=100)
vec = VectorXYZ(XComponent=0, YComponent=0, ZComponent=0)  # -> Vector, Length
vec_2 = VectorXYZ(XComponent=0, YComponent=0, ZComponent=1000)  # -> Vector, Length
B = Beam(Lines=ln, CrossSection=cs, Material=M)
S = NodeSupport(Points=pt_2, UX=True, UY=True, UZ=True, RX=True, RY=True, RZ=True)
L = NodalLoad(Points=pt, Force=vec_2.Vector, Moment=vec.Vector)
A = AssembleModel(Elements=B, Supports=S, Loads=L, ModelType=0)
