# Grasshopper definition test-membrane.gh (Grasshopper 0.9.14)
# plug-ins: SharpFEGrasshopper.Core

pt = PointXYZ(XComponent=0, YComponent=3000, ZComponent=0, System=PlaneXY(0, 0, 0))
pt_2 = PointXYZ(XComponent=3000, YComponent=0, ZComponent=0, System=PlaneXY(0, 0, 0))
pt_3 = PointXYZ(XComponent=3000, YComponent=3000, ZComponent=0, System=PlaneXY(0, 0, 0))
pt_4 = PointXYZ(XComponent=0, YComponent=0, ZComponent=0, System=PlaneXY(0, 0, 0))
M = ElasticMaterial(YoungsModulus=210000, Density=100, PoissonsRatio=0.3, ShearModulus=1000)
vec = VectorXYZ(XComponent=0, YComponent=2000, ZComponent=0)  # -> Vector, Length
vec_2 = VectorXYZ(XComponent=0, YComponent=0, ZComponent=0)  # -> Vector, Length
triangle = MeshTriangle(CornerA=1, CornerB=2, CornerC=3)
triangle_2 = MeshTriangle(CornerA=0, CornerB=1, CornerC=2)
L = NodalLoad(Points=pt, Force=vec.Vector, Moment=vec_2.Vector)
mesh = Mesh(Vertices=[pt_4, pt_2, pt, pt_3], Faces=[triangle_2, triangle])
S = NodeSupport(Points=[pt, pt_3], UX=False, UY=False, UZ=True, RX=False, RY=False, RZ=False)
S_2 = NodeSupport(Points=[pt_2, pt_4], UX=True, UY=True, UZ=True, RX=False, RY=False, RZ=False)
T = ConstantStrainTriangle(Mesh=mesh, Material=M, Thickness=100)
A = AssembleModel(Elements=T, Supports=[S_2, S], Loads=L, ModelType=2)
calc = LinearAnalysis(SharpFEModel=A)
